# Dynamo graph dynamo_model_sample_app.dyn "dynamo_model_sample_app_v2" (Dynamo 2.13.1.3887)

XY = Plane.XY()
width = IntegerSlider(6, range=4..6 step 1)  # graph input
depth = IntegerSlider(5, range=5..10 step 1)  # graph input
byWidthLength = Rectangle.ByWidthLength(plane=XY, width=width, length=depth)
number_of_floors = IntegerSlider(2, range=1..5 step 1)  # graph input
height_floor = DoubleSlider(3, range=2..3 step 0.1)  # graph input
total_height = CodeBlock(n_floors=number_of_floors, height_floor=height_floor) { n_floors*height_floor; }
height_floors_list = CodeBlock(n_floors=total_height, height_floor=height_floor) { 0..n_floors..height_floor; }
translate = Geometry.Translate(geometry=byWidthLength, zTranslation=height_floors_list)
list_create = List.Create(item0=byWidthLength, item1=translate)
flatten = List.Flatten(list=list_create)
number_of_houses = IntegerSlider(2, range=1..8 step 1)  # graph input
cycle = List.Cycle(list=flatten, amount=number_of_houses)
code_block = CodeBlock(n=number_of_floors) { n+2; }
chop = List.Chop(list=cycle, lengths=code_block)
code_block_2 = CodeBlock(n_houses=number_of_houses, width=width) { 0..n_houses*width..width; }
translate_2 = Geometry.Translate(geometry=chop, xTranslation=code_block_2)
byRuledLoft = Solid.ByRuledLoft(crossSections=translate_2)
height_roof = DoubleSlider(3, range=2..3 step 0.1)  # graph input
roof_back = CodeBlock(width=width, depth=depth, total_height=total_height, height_roof=height_roof)
# ---------- roof_back.designscript (3 lines) ----------
x=[-width/2,width/2,width/2,-width/2];
y=[depth/2,depth/2,0,0];
z=[total_height,total_height,total_height+height_roof,total_height+height_roof];
# ----------------------------------------
byCoordinates = Point.ByCoordinates(x=roof_back.x, y=roof_back.y, z=roof_back.z)
byCornerPoints = Rectangle.ByCornerPoints(points=byCoordinates)
byPatch = Surface.ByPatch(closedCurve=byCornerPoints)
code_block_3 = CodeBlock(n_houses=number_of_houses, width=width) { 0..(n_houses-1)*width..width; }
translate_3 = Geometry.Translate(geometry=byPatch, xTranslation=code_block_3)
roof_front = CodeBlock(width=width, depth=depth, total_height=total_height, height_roof=height_roof)
# ---------- roof_front.designscript (3 lines) ----------
x=[width/2,-width/2,-width/2,width/2];
y=[-depth/2,-depth/2,0,0];
z=[total_height,total_height,total_height+height_roof,total_height+height_roof];
# ----------------------------------------
byCoordinates_2 = Point.ByCoordinates(x=roof_front.x, y=roof_front.y, z=roof_front.z)
byCornerPoints_2 = Rectangle.ByCornerPoints(points=byCoordinates_2)
byPatch_2 = Surface.ByPatch(closedCurve=byCornerPoints_2)
translate_4 = Geometry.Translate(geometry=byPatch_2, xTranslation=code_block_3)
roof_closure_left_end_side = CodeBlock(width=width, depth=depth, total_height=total_height, height_roof=height_roof) { x=[-width/2,-width/2,-width/2]; y=[depth/2,0,-depth/2]; z=[total_height,total_height+height_roof,total_height]; }
byCoordinates_3 = Point.ByCoordinates(x=roof_closure_left_end_side.x, y=roof_closure_left_end_side.y, z=roof_closure_left_end_side.z)
byPoints = Polygon.ByPoints(points=byCoordinates_3)
byPatch_3 = Surface.ByPatch(closedCurve=byPoints)
translate_5 = Geometry.Translate(geometry=byPatch_3, xTranslation=code_block_3)
roof_closure_right_end_side = CodeBlock(width=width, depth=depth, total_height=total_height, height_roof=height_roof) { x=[width/2,width/2,width/2]; y=[depth/2,0,-depth/2]; z=[total_height,total_height+height_roof,total_height]; }
byCoordinates_4 = Point.ByCoordinates(x=roof_closure_right_end_side.x, y=roof_closure_right_end_side.y, z=roof_closure_right_end_side.z)
byPoints_2 = Polygon.ByPoints(points=byCoordinates_4)
byPatch_4 = Surface.ByPatch(closedCurve=byPoints_2)
translate_6 = Geometry.Translate(geometry=byPatch_4, xTranslation=code_block_3)
translate_7 = Geometry.Translate(xTranslation=code_block_3)  # unwired: geometry
floor_area_per_house = CodeBlock(length=depth, width=width, n_floors=number_of_floors) { length*width*n_floors; }
output_floor_area_per_house = Watch(floor_area_per_house)  # graph output
total_cost = CodeBlock(n_houses=number_of_houses, n_floors=number_of_floors, length=depth, width=width, height_floor=height_floor, height_roof=height_roof) { n_houses*n_floors*length*width*1300*(1+0.1*height_floor)*(1+0.1*height_roof); }
output_total_cost = Watch(total_cost)  # graph output
MKI = CodeBlock(n_houses=number_of_houses, n_floors=number_of_floors, length=depth, width=width, height_floor=height_floor, height_roof=height_roof) { n_houses*n_floors*length*width*763*(1+0.1*height_floor)*(1+0.1*height_roof); }
output_mki = Watch(MKI)  # graph output
MKI_2 = CodeBlock(n_houses=number_of_houses, n_floors=number_of_floors, length=depth, width=width, height_floor=height_floor, height_roof=height_roof) { n_houses*n_floors*length*width*0.015*(1+0.1*height_floor)*(1+0.1*height_roof); }
output_co2 = Watch(MKI_2)  # graph output
